# Grasshopper definition garten_knit.gh (Grasshopper 1.0.4)

number_slider = Slider(10, range=0..10)  # disabled
crv = Curve(<curve referenced from the Rhino model>)  # disabled
number_slider_2 = Slider(1, range=0..1)  # disabled
pt = Point(Point(0, 0, 1))
end = EndPoints(Curve=crv)  # -> Start, End; disabled
series = Series(Start=number_slider_2, Step=1, Count=number_slider)  # disabled
mover = Mover(G=pt, F=Slider(0, range=0..100), F_2=Slider(3, range=0..10))
vec2pt = Vector2Pt(PointA=end.Start, PointB=end.End, Unitize=False)  # -> Vector, Length; disabled
multiplication = Multiplication(A=vec2pt.Vector, B=series)  # disabled
mover_2 = Mover(G=mover, F=Slider(5, range=0..10), F_2=Slider(-1, range=-1..0))
move = Move(Geometry=crv, Motion=multiplication)  # -> Geometry, Transform; disabled
mover_3 = Mover(G=mover_2, F=Slider(5, range=0..10), F_2=Slider(-1, range=-2..0))
yz = YZPlane(Origin=Point(0, 0, 0))
X = UnitX(Factor=Slider(5, range=0..10))
Z = UnitZ(Factor=Slider(3, range=0..10))
move_2 = Move(Geometry=mover_3, Motion=Z)  # -> Geometry, Transform
merge = Merge(Data1=pt, Data2=mover, Data3=mover_2, Data4=move_2.Geometry)
move_3 = Move(Geometry=yz, Motion=X)  # -> Geometry, Transform
mirror = Mirror(Geometry=merge, Plane=move_3.Geometry)  # -> Geometry, Transform
rev = ReverseList(List=mirror.Geometry)
merge_2 = Merge(Data1=merge, Data2=rev)
intcrv = Interpolate(Vertices=merge_2, Degree=3, Periodic=False, KnotStyle=1)  # -> Curve, Length, Domain
cluster = Cluster(C=intcrv.Curve, C_2=Slider(10, range=0..10))
pipe = Pipe(Curve=cluster, Radius=1, Caps=0)
number_slider_3 = Slider(5, range=0..10)
multiplication_2 = Multiplication(A=number_slider_3, B=Slider(2, range=0..10))
series_2 = Series(Start=Slider(0, range=0..100), Step=multiplication_2, Count=Slider(10, range=0..10))
cluster_2 = Cluster_2(G=pipe, F_3=number_slider_3, F=Slider(5, range=0..10), F_2=Slider(-5, range=-5..0))
Y = UnitY(Factor=series_2)
move_4 = Move(Geometry=pipe, Motion=Y)  # -> Geometry, Transform
move_5 = Move(Geometry=cluster_2, Motion=Y)  # -> Geometry, Transform

# ==== cluster Mover
F = ClusterInput()
Y = UnitY(Factor=F)
G = ClusterInput()
F_2 = ClusterInput()
move = Move(Geometry=G, Motion=Y)  # -> Geometry, Transform
X = UnitX(Factor=F_2)
move_2 = Move(Geometry=move.Geometry, Motion=X)  # -> Geometry, Transform
G_2 = ClusterOutput(move_2.Geometry)

# ==== cluster Cluster
C = ClusterInput()
C_2 = ClusterInput()
end = EndPoints(Curve=C)  # -> Start, End
series = Series(Start=Slider(0, range=0..100), Step=1, Count=C_2)
vec2pt = Vector2Pt(PointA=end.Start, PointB=end.End, Unitize=False)  # -> Vector, Length
multiplication = Multiplication(A=vec2pt.Vector, B=series)
move = Move(Geometry=C, Motion=multiplication)  # -> Geometry, Transform
join = JoinCurves(Curves=move.Geometry, Preserve=False)
C_3 = ClusterOutput(join)

# ==== cluster Cluster_2
xy = XYPlane(Origin=Point(0, 0, 0))
G = ClusterInput()
mirror = Mirror(Geometry=G, Plane=xy)  # -> Geometry, Transform
F = ClusterInput()
X = UnitX(Factor=F)
F_2 = ClusterInput()
move = Move(Geometry=mirror.Geometry, Motion=X)  # -> Geometry, Transform
Y = UnitY(Factor=F_2)
move_2 = Move(Geometry=move.Geometry, Motion=Y)  # -> Geometry, Transform
F_3 = ClusterInput()
Z = UnitZ(Factor=F_3)
move_3 = Move(Geometry=move_2.Geometry, Motion=Z)  # -> Geometry, Transform
G_2 = ClusterOutput(move_3.Geometry)
